# Grasshopper definition sample.gh (Grasshopper 0.9.76)
# plug-ins: DetectEmpty

c_script = CSharpScript()  # -> out, A
# ---------- c_script: C# ----------
    A = new List<string>{"qwe","","asd","","zxc"};
# ---------- end c_script ----------
panel = Panel(c_script.A)
filterempty = FilterEmpty(Input=panel)  # -> Filtered, EmptyIndexes, IsEmpty, Nulls
panel_2 = Panel(filterempty.EmptyIndexes)
panel_3 = Panel(filterempty.IsEmpty)
panel_4 = Panel(filterempty.Filtered)
panel_5 = Panel(filterempty.Nulls)
